# Grasshopper definition trapeziod.gh (Grasshopper 1.0.7)
# plug-ins: Pufferfish

rows = Slider(4, range=0..10)
base_length = Slider(9.4, range=0..10)
a_divisions = Slider(7, range=1..10)
height = Slider(7.8, range=0..20)
a_divisions_2 = Slider(5, range=1..10)
rows_2 = Slider(4, range=0..10)
base_length_2 = Slider(7.9, range=0..10)
height_2 = Slider(10.5, range=0..20)
X = UnitX(Factor=base_length)
pt = ConstructPoint(XCoordinate=0, YCoordinate=0, ZCoordinate=0)

# ---- group: computes second basis lenght
division = Division(A=base_length, B=a_divisions)
subtraction = Subtraction(A=a_divisions, B=rows)
multiplication = Multiplication(A=division, B=subtraction)

# ----
division_2 = Division(A=base_length_2, B=a_divisions_2)
move = Move(Geometry=pt, Motion=X)  # -> Geometry, Transform
trigrid = Triangular(Plane=PlaneXY(0, 0, 0), Size=division_2, ExtentX=expr("x*2", a_divisions_2), ExtentY=rows_2)  # -> Cells, Points
avr = Average(Input=[pt, move.Geometry])
brec = BoundingRectangle(Geometry=flatten(trigrid.Cells), Plane=PlaneXY(0, 0, 0), Axis=0, Slide=0, Union=True)  # -> Bounding, DimensionX, DimensionY
series = Series(Start=expr("2*(x-1)", a_divisions_2), Step=-1, Count=rows_2)  # -> graft(Series)
series_2 = Series(Start=0, Step=1, Count=rows_2)  # -> graft(Series)
division_3 = Division(A=height_2, B=brec.DimensionY)
Y = UnitY(Factor=height)
scale_nu = ScaleNU(Geometry=trigrid.Cells, Plane=PlaneXY(0, 0, 0), ScaleX=1, ScaleY=division_3, ScaleZ=1)  # -> simplify(Geometry), Transform
dom = ConstructDomain(DomainStart=series_2, DomainEnd=series)
flip = FlipMatrix(Data=scale_nu.Geometry)
panel = Panel(dom)
subset = SubList(List=flip, Domain=dom, Wrap=False)  # -> List, Index
crv = Curve(subset.List)

ln = Line(StartPoint=pt, EndPoint=move.Geometry)

scale2len = ScaleToLength(Curve=ln, Plane=avr, Length=multiplication, FactorX=1, FactorY=1, FactorZ=1)  # -> Scaled, Transform

move_2 = Move(Geometry=scale2len.Scaled, Motion=Y)  # -> Geometry, Transform

divide = DivideCurve(Curve=move_2.Geometry, Count=subtraction, Kinks=False)  # -> Points, Tangents, Parameters
divide_2 = DivideCurve(Curve=ln, Count=a_divisions, Kinks=False)  # -> Points, Tangents, Parameters
rev = ReverseList(List=divide.Points)
rev_2 = ReverseList(List=divide_2.Points)

item = ListItem(List=divide.Points, Index=0, Wrap=True)
item_2 = ListItem(List=rev, Index=0, Wrap=True)

item_3 = ListItem(List=rev_2, Index=0, Wrap=True)
item_4 = ListItem(List=divide_2.Points, Index=0, Wrap=True)

ln_2 = Line(StartPoint=item, EndPoint=item_4)
ln_3 = Line(StartPoint=item_2, EndPoint=item_3)
divide_3 = DivideCurve(Curve=ln_2, Count=rows, Kinks=False)  # -> Points, Tangents, Parameters
divide_4 = DivideCurve(Curve=ln_3, Count=rows, Kinks=False)  # -> Points, Tangents, Parameters
cull_i = CullIndex(List=divide_3.Points, Indices=[0, -1], Wrap=True)
cull_i_2 = CullIndex(List=divide_4.Points, Indices=[0, -1], Wrap=True)
merge = Merge(Data1=rev, Data2=cull_i)  # -> flatten(Result)
merge_2 = Merge(Data1=divide.Points, Data2=cull_i_2)  # -> flatten(Result)
short = ShortestList(ListA=divide_2.Points, ListB=merge_2, TrimMode=2)  # -> ListA, ListB
short_2 = ShortestList(ListA=merge, ListB=rev_2, TrimMode=2)  # -> ListA, ListB

ln_4 = Line(StartPoint=divide_3.Points, EndPoint=divide_4.Points)
ln_5 = Line(StartPoint=short_2.ListA, EndPoint=short_2.ListB)
ln_6 = Line(StartPoint=short.ListA, EndPoint=short.ListB)
